# Grasshopper definition Aymeric_Energy_Sim.gh (Grasshopper 1.0.8)
# plug-ins: RhinoCodePluginGH, Pufferfish, SliderRemote, LunchBox, ShapeDiverForGrasshopper, Colibri

sddp = ShapeDiverDocumentPayload({AbsoluteTolerance=0, AngleTolerance=0, DistanceDisplayPrecision=0, GltfVersion="Gltf2", GrasshopperVersion="1.0.0008", InputGroups="{}", OutputGroups="{}", RelativeTolerance=0, RhinoVersion="8.14.24345.15001", UnitSystem=0, VersionCreated="1.26.0.0", VersionSaved="1.26.0.0"})

# ----
# Path to the Export folder
# for new csv data
# It should be an
# empty folder!!!!
# 3
panel = Panel("C:\Users\User\Documents\IAAC\Module03\Encoding\Energy\V3")

# ----
# Path to the JSON folder
# with the iterations
# 1
panel_2 = Panel("C:\Users\User\Documents\IAAC\Module03\Studio\AIA25_Studio\Energy\DATA EXPORT\JSON")

# ----
# Run the first
# energy Simulation
# (Set to True)
# 4
boolean_toggle = BooleanToggle(False)

# ----
# Start the recording
# (Set to True)
# 5
boolean_toggle_2 = BooleanToggle(False)

# ----
# 2
# Update Path!
update = Button()

# ----
# 0: Andres
# 1: Marco
# 2: Joaquin
# 3: César
# 4: Aymeric
wwr = Slider(4, range=0..4)
iteration = Slider(15, range=0..28)
energystandard = Slider(1, range=0..1)
weather = Slider(5, range=0..6)

# ----
# Start the iterations
# (Press Fly)
# 6
colibri_iterator = ColibriIterator(Weather=weather, ITERATION=iteration, EnergyStandard=energystandard, RemoteFly=False, ignoreAllWarningMsg=False)  # -> Weather, ITERATION, EnergyStandard, Iteration_Genome

point = Point(Point(-8.697172349, -11.10824437, 0))
hb_climate_zones = HBClimateZones({"1 - Very Hot": "1", "2 - Hot": "2", "3 - Warm": "3", "4 - Mixed": "4", "5 - Cool": "5", "6 - Cold": "6", "7 - Very Cold": "7", "8 - Subarctic": "8"}, selected=["1 - Very Hot", "2 - Hot", "3 - Warm", "4 - Mixed", "5 - Cool", "6 - Cold", "7 - Very Cold"])
compass = LBCompass(center=point, scale=Slider(0.3, range=0..1))  # -> compass; plug-in component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

list_length = ListLength(List=hb_climate_zones)
x_minus_one = XMinusOne(NumberX=list_length)
slider_remote_control = SliderRemoteControl(SilderName="Weather", MinimumValue=0, MaximumValue=x_minus_one)

file_path = FilePath(panel_2)
python_3_script = Python3Script(dirPath=file_path, refresh=update)  # -> out, full_paths, file_names, error_msg; inputs dirPath: String
# ---------- python_3_script: Python ----------
import os
import re

# Natural sort key
def natural_key(s):
    return [int(text) if text.isdigit() else text.lower() for text in re.split(r'(\d+)', s)]

# Default outputs
files = []
full_paths = []
file_names = []
error_msg = None

# Validate input
if dirPath and isinstance(dirPath, str) and os.path.isdir(dirPath):
    files = os.listdir(dirPath)
    files = sorted(files, key=natural_key)  # Natural sort
    full_paths = [os.path.join(dirPath, f) for f in files]
    file_names = [os.path.splitext(f)[0] for f in files]
else:
    error_msg = "Invalid or empty directory path. Please provide a valid path."
# ---------- end python_3_script ----------
list_length_2 = ListLength(List=python_3_script.full_paths)
x_minus_one_2 = XMinusOne(NumberX=list_length_2)
slider_remote_control_2 = SliderRemoteControl(SilderName=graft("ITERATION"), MinimumValue=0, MaximumValue=x_minus_one_2)
list_item = ListItem(List=python_3_script.full_paths, Index=iteration, Wrap=True)
list_item_2 = ListItem(List=python_3_script.file_names, Index=iteration, Wrap=True)
file_path_2 = FilePath(list_item)
# Next!
loadobjects = HBLoadObjects(hb_file=file_path_2, load=Toggle(True))  # -> out, hb_objs; plug-in component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

number_slider = Slider(0.1, range=0..0.1)

# ---- group: WWR_Ranges and Control
number_slider_2 = Slider(5, range=0..10)
x_minus_one_3 = XMinusOne(NumberX=number_slider_2)
data = Data("WWR")
division = Division(A=Slider(0.9, range=0..1), B=number_slider_2)
series = Series(Start=number_slider, Step=division, Count=number_slider_2)
slider_remote_control_3 = SliderRemoteControl(SilderName=graft(data), MinimumValue=number_slider, MaximumValue=x_minus_one_3)

# ----
bld = Data(list_item_2)

hot_dry = Panel("https://climate.onebuilding.org/WMO_Region_2_Asia/ARE_United_Arab_Emirates/ARE_DU_Dubai.Intl.AP.411940_TMYx.zip")
warmmarine = Panel("https://climate.onebuilding.org/WMO_Region_5_Southwest_Pacific/AUS_Australia/NSW_New_South_Wales/AUS_NSW_Sydney.Obs-Observatory.Hill.947680_TMYx.zip")
hot_humid = Panel("https://energyplus-weather.s3.amazonaws.com/southwest_pacific_wmo_region_5/SGP/SGP_Singapore.486980_IWEC/SGP_Singapore.486980_IWEC.zip")
mixed_humid = Panel("https://climate.onebuilding.org/WMO_Region_4_North_and_Central_America/USA_United_States_of_America/NY_New_York/USA_NY_New.York-Downtown.Manhattan.Heli.720553_TMYx.zip")
cool_humid = Panel("https://climate.onebuilding.org/WMO_Region_6_Europe/DEU_Germany/BE_Berlin/DEU_BE_Berlin-Tegel.AP.103820_TMYx.zip")
cold = Panel("https://climate.onebuilding.org/WMO_Region_6_Europe/SWE_Sweden/ST_Stockholm/SWE_ST_Stockholm.024850_TMYx.zip")
verycold_arctic = Panel("https://climate.onebuilding.org/WMO_Region_6_Europe/ISL_Iceland/HO_Capital/ISL_HO_Reykjavik.AP.040300_TMYx.zip")

hb_building_vintages = HBBuildingVintages({"ASHRAE 90.1 2019  |  IECC 2021": "2019", "ASHRAE 90.1 2016  |  IECC 2018": "2016", "ASHRAE 90.1 2013  |  IECC 2015": "2013", "ASHRAE 90.1 2010  |  IECC 2012": "2010", "ASHRAE 90.1 2007  |  IECC 2009": "2007", "ASHRAE 90.1 2004  |  IECC 2006": "2004", "1980-2004 (CBECS)": "1980_2004", "Pre-1980 (CBECS)": "pre_1980"}, selected="ASHRAE 90.1 2019  |  IECC 2021")
hb_construction_types = HBConstructionTypes({"SteelFramed", "WoodFramed", "Mass", "Metal Building"}, selected="Mass")
list_item_3 = ListItem(List=hb_climate_zones, Index=weather, Wrap=True)
constrsetclimate = HBConstructionSetByClimate(climate_zone=list_item_3, vintage=hb_building_vintages, constr_type=hb_construction_types)  # -> constr_set; plug-in component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

panel_3 = Panel(series)

list_item_4 = ListItem(List=series, Index=wwr, Wrap=True)
list_item_5 = ListItem(List=series, Index=wwr, Wrap=True)
list_item_6 = ListItem(List=series, Index=wwr, Wrap=True)
list_item_7 = ListItem(List=series, Index=wwr, Wrap=True)
wwr_w = Data(list_item_5)
wwr_n = Data(list_item_6)
wwr_s = Data(list_item_4)
wwr_e = Data(list_item_7)
facparam = HBFacadeParameters(north=wwr_n, east=wwr_e, south=wwr_s, west=wwr_w)  # -> fac_par; plug-in component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
wwr_2 = Data(wwr_n)

rotate = HBRotate(hb_objs=flatten(loadobjects.hb_objs))  # -> hb_objs; disabled; plug-in component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

x_minus_one_4 = XMinusOne(NumberX=list_item_3)
weather_type = Panel("""1A_VeryHot_Humid
2B_Hot_Dry
3C_Warm_Marine
4A_Mixed_Humid
5A_Cool_Humid
6A_Cold
7/8_Very_Cold/Arctic""")
stream_filter = StreamFilter(
    Gate=x_minus_one_4,
    Stream0=hot_humid,
    Stream1=hot_dry,
    Stream2=warmmarine,
    Stream3=mixed_humid,
    Stream4=cool_humid,
    Stream5=cold,
    Stream6=verycold_arctic)
downloadepw = LBDownloadWeather(weather_URL=stream_filter)  # -> epw_file, stat_file, ddy_file; plug-in component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
list_item_8 = ListItem(List=weather_type, Index=x_minus_one_4, Wrap=True)
weather_type_2 = Data(list_item_8)

file_path_3 = FilePath("C:\Users\User\Documents\IAAC\Module03\Encoding\Weather\U-Values.csv")
read_file = ReadFile(File=file_path_3, PerLineParse=True)
read_csv = ReadCSV(CSVString=read_file, Delimiter=",", DataStruct=False)  # -> Headers, Values
panel_4 = Panel(read_csv.Headers)
panel_5 = Panel(read_csv.Values)
list_item_9 = ListItem(List=read_csv.Values, Index=x_minus_one_4, Wrap=True)
explode_tree = ExplodeTree(Data=list_item_9)  # -> Branch0, Branch1, Branch2, Branch3, Branch4, Branch5, Branch6, Branch7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
entwine = Entwine(
    Branch00=explode_tree.Branch2,
    Branch01=explode_tree.Branch4,
    Branch02=explode_tree.Branch6,
    Branch03=explode_tree.Branch8,
    Branch04=explode_tree.Branch10,
    Branch05=explode_tree.Branch12,
    FlattenInputs=True)
entwine_2 = Entwine(
    Branch00=explode_tree.Branch1,
    Branch01=explode_tree.Branch3,
    Branch02=explode_tree.Branch5,
    Branch03=explode_tree.Branch7,
    Branch04=explode_tree.Branch9,
    Branch05=explode_tree.Branch11,
    FlattenInputs=True)
stream_filter_2 = StreamFilter(Gate=energystandard, Stream0=entwine, Stream1=entwine_2)

deconstructmodel = HBDeconstructModel(model=loadobjects.hb_objs)  # -> rooms, faces, apertures, doors, shades; plug-in component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
boolean_toggle_3 = BooleanToggle(True)
intsolid = HBIntersectSolids(rooms=flatten(deconstructmodel.rooms), run=boolean_toggle_3)  # -> int_rooms; plug-in component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
solveadj = HBSolveAdjacency(rooms=flatten(intsolid), adiabatic=Toggle(True), run=boolean_toggle_3)  # -> out, adj_rooms; plug-in component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
aperturesbyratio = HBAperturesByRatio(hb_objs=flatten(solveadj.adj_rooms), ratio=facparam)  # -> out, hb_objs; plug-in component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

cluster = Cluster_3(data=stream_filter_2)  # -> constr_2, constr, constr_3, constr_4
exteriorsubset = HBExteriorConstructionSubset(exterior_wall=cluster.constr, exterior_roof=cluster.constr_3, exposed_floor=cluster.constr_2)  # -> exterior_set; plug-in component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
subfacesubset = HBSubfaceSubset(window=cluster.constr_4)  # -> subface_set; plug-in component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
groundsubset = HBGroundConstructionSubset(ground_floor=cluster.constr_2)  # -> ground_set; plug-in component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
constructionset = HBConstructionSet(
    base_constr_set=constrsetclimate,
    exterior_subset=exteriorsubset,
    ground_subset=groundsubset,
    subface_subset=subfacesubset)  # -> constr_set; plug-in component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

# ---- group: Shading or not
externalshading = Slider(0, range=0..1)  # disabled

# ----
externalshadingon = BooleanToggle(True)  # disabled
externalshadingoff = BooleanToggle(False)  # disabled
stream_filter_3 = StreamFilter(Gate=externalshading, Stream0=externalshadingoff, Stream1=externalshadingon)  # disabled

number_slider_3 = Slider(0.2, range=0.1..0.5)  # disabled
number_slider_4 = Slider(0.05, range=0..0.1)  # disabled
number_slider_5 = Slider(10, range=0..10)  # disabled
bordershades = HBExtrudedBorderShades(hb_objs=flatten(aperturesbyratio.hb_objs), depth=number_slider_3)  # -> out, hb_objs; disabled; plug-in component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
louvershades = HBLouverShades(hb_objs=flatten(bordershades.hb_objs), depth=number_slider_4, shade_count=number_slider_5)  # -> readMe, hb_objs; disabled; plug-in component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
stream_filter_4 = StreamFilter(Gate=stream_filter_3, Stream0=bordershades.hb_objs, Stream1=louvershades.hb_objs)  # disabled

boolean_toggle_4 = BooleanToggle(True)
number_slider_6 = Slider(0.75, range=0..1)
hb_all_air_hvac_templates = HBAllAirHVACTemplates({"VAV chiller with gas boiler reheat": "VAV_Chiller_Boiler", "VAV chiller with central air source heat pump reheat": "VAV_Chiller_ASHP", "VAV chiller with district hot water reheat": "VAV_Chiller_DHW", "VAV chiller with PFP boxes": "VAV_Chiller_PFP", "VAV chiller with gas coil reheat": "VAV_Chiller_GasCoil", "VAV air-cooled chiller with gas boiler reheat": "VAV_ACChiller_Boiler", "VAV air-cooled chiller with central air source heat pump reheat": "VAV_ACChiller_ASHP", "VAV air-cooled chiller with district hot water reheat": "VAV_ACChiller_DHW", "VAV air-cooled chiller with PFP boxes": "VAV_ACChiller_PFP", "VAV air-cooled chiller with gas coil reheat": "VAV_ACChiller_GasCoil"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}, selected="VAV air-cooled chiller with central air source heat pump reheat")
hb_doas_hvac_templates = HBDOASHVACTemplates({"DOAS with fan coil chiller with boiler": "DOAS_FCU_Chiller_Boiler", "DOAS with fan coil chiller with central air source heat pump": "DOAS_FCU_Chiller_ASHP", "DOAS with fan coil chiller with district hot water": "DOAS_FCU_Chiller_DHW", "DOAS with fan coil chiller with baseboard electric": "DOAS_FCU_Chiller_ElectricBaseboard", "DOAS with fan coil chiller with gas unit heaters": "DOAS_FCU_Chiller_GasHeaters", "DOAS with fan coil chiller with no heat": "DOAS_FCU_Chiller", "DOAS with fan coil air-cooled chiller with boiler": "DOAS_FCU_ACChiller_Boiler", "DOAS with fan coil air-cooled chiller with central air source heat pump": "DOAS_FCU_ACChiller_ASHP", "DOAS with fan coil air-cooled chiller with district hot water": "DOAS_FCU_ACChiller_DHW", "DOAS with fan coil air-cooled chiller with baseboard electric": "DOAS_FCU_ACChiller_ElectricBaseboard"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}, selected="DOAS with fan coil air-cooled chiller with central air source heat pump")
hb_heatcool_hvac_templates = HBHeatCoolHVACTemplates({"Baseboard electric": "ElectricBaseboard", "Baseboard gas boiler": "BoilerBaseboard", "Baseboard central air source heat pump": "ASHPBaseboard", "Baseboard district hot water": "DHWBaseboard", "Direct evap coolers with baseboard electric": "EvapCoolers_ElectricBaseboard", "Direct evap coolers with baseboard gas boiler": "EvapCoolers_BoilerBaseboard"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}, selected="Residential AC with baseboard central air source heat pump": "ResidentialAC_ASHPBaseboard")
value_list = ValueList({"Ideal HVAC": 0, "VAV_ACChiller_ASHP": 1, "DOAS_FCU_ACChiller_ASHP": 2, "ResidentialAC_ASHPBaseboard": 3}, selected="Ideal HVAC")
hvac = Slider(0, range=0..1)
panel_6 = Panel(["Ideal HVAC", hb_all_air_hvac_templates, hb_doas_hvac_templates, hb_heatcool_hvac_templates])
doashvac = HBDOASHVAC(
    rooms=flatten(aperturesbyratio.hb_objs),
    system_type=hb_doas_hvac_templates,
    sensible_hr=number_slider_6,
    latent_hr=number_slider_6,
    dcv=boolean_toggle_4)  # -> out, rooms; plug-in component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
idealair = HBIdealAir(
    rooms=flatten(aperturesbyratio.hb_objs),
    economizer="DifferentialDryBulb",
    dcv=boolean_toggle_4,
    sensible_hr=number_slider_6,
    latent_hr=number_slider_6)  # -> out, rooms; plug-in component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
heatcoolhvac = HBHeatCoolHVAC(rooms=flatten(aperturesbyratio.hb_objs), system_type=hb_heatcool_hvac_templates)  # -> out, rooms; plug-in component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
allairhvac = HBAllAirHVAC(
    rooms=flatten(aperturesbyratio.hb_objs),
    system_type=hb_all_air_hvac_templates,
    economizer="DifferentialDryBulb",
    sensible_hr=number_slider_6,
    latent_hr=number_slider_6,
    dcv=boolean_toggle_4)  # -> out, rooms; plug-in component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
list_item_10 = ListItem(List=value_list, Index=hvac, Wrap=True)
list_item_11 = ListItem(List=panel_6, Index=list_item_10, Wrap=True)
hvac_name = Data(list_item_11)
stream_filter_5 = StreamFilter(Gate=list_item_10, Stream0=idealair.rooms, Stream1=allairhvac.rooms, Stream2=doashvac.rooms, Stream3=heatcoolhvac.rooms)

list_length_3 = ListLength(List=value_list)
x_minus_one_5 = XMinusOne(NumberX=list_length_3)
slider_remote_control_4 = SliderRemoteControl(SilderName="HVAC", MinimumValue=0, MaximumValue=x_minus_one_5)

applyconstrset = HBApplyConstructionSet(rooms=stream_filter_5, constr_set=constructionset)  # -> rooms; plug-in component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

hb_room_attributes = HBRoomAttributes({"Display Name": "display_name", "Simulation Name (Identifier)": "identifier", "Multiplier": "multiplier", "Floor Area Excluded": "exclude_floor_area", "Story": "story", "Volume": "volume", "Gross Floor Area": "floor_area", "Exposed Area": "exposed_area", "Exterior Wall Area": "exterior_wall_area", "Exterior Aperture Area": "exterior_aperture_area", "Average Floor Elevation": "average_floor_height"}, selected="Volume")
colorroomattr = HBColorRoomAttributes(rooms_model=flatten(applyconstrset), attribute=hb_room_attributes)  # -> mesh, legend, wire_frame, values, colors, vis_set; plug-in component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

vizbytype = HBVisualizeByType(hb_objs=aperturesbyratio.hb_objs)  # -> walls, interior_walls, roofs, ceilings, exterior_floors, interior_floors, air_walls, apertures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; plug-in component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
mesh = Mesh(vizbytype.walls)
mesh_2 = Mesh(vizbytype.roofs)
mesh_3 = Mesh(vizbytype.apertures)
area = Area(Geometry=mesh)  # -> EWM2, Centroid
area_2 = Area(Geometry=mesh_2)  # -> RO_M2, Centroid
area_3 = Area(Geometry=mesh_3)  # -> WI_M2, Centroid

mesh_4 = Mesh(vizbytype.exterior_floors)
area_4 = Area(Geometry=mesh_4)  # -> ES_M2, Centroid

# ---- group: kg CO₂e per kWh
worldwide_average_electricity_emission_f = Panel("0.45")  # "Worldwide Average Electricity Emission Factor"

# ----
mass_addition = MassAddition(Input=[area.EWM2, area_2.RO_M2, area_4.ES_M2, area_3.WI_M2])  # -> Result, PartialResults
mass_addition_2 = MassAddition(Input=colorroomattr.values)  # -> VolumeM3, PartialResults
division_2 = Division(A=mass_addition.Result, B=mass_addition_2.VolumeM3)

colour_swatch = ColourSwatch(SwatchColor=RGB(105, 123, 181))
geometry = Geometry(compass)
mesh_colours = MeshColours(Mesh=mesh, Colours=ColourSwatch(SwatchColor=RGB(171, 173, 207)))
custom_preview = CustomPreview(Geometry=geometry, Material=colour_swatch)
mesh_colours_2 = MeshColours(Mesh=mesh_2, Colours=colour_swatch)
mesh_colours_3 = MeshColours(Mesh=mesh_4, Colours=ColourSwatch(SwatchColor=RGB(92, 92, 92)))
mesh_colours_4 = MeshColours(Mesh=mesh_3, Colours=ColourSwatch(SwatchColor=RGBA(255, 255, 255, 198)))

annualloads = HBAnnualLoads(rooms=flatten(applyconstrset), epw_file=downloadepw.epw_file, run=boolean_toggle)  # -> out, total_load, cooling, heating, lighting, equip, process, hot_water, balance; plug-in component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
mass_addition_3 = MassAddition(Input=annualloads.total_load)  # -> EUIKWhM2a, PartialResults
multiplication = Multiplication(A=mass_addition_3.EUIKWhM2a, B=worldwide_average_electricity_emission_f)

entwine_3 = Entwine(
    Branch00=annualloads.cooling,
    Branch01=annualloads.heating,
    Branch02=annualloads.lighting,
    Branch03=annualloads.equip,
    FlattenInputs=True)
xdata = LBDeconstructData(data=entwine_3)  # -> header, values; plug-in component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
mass_addition_4 = MassAddition(Input=xdata.values)  # -> Result, PartialResults

explode_tree_2 = ExplodeTree(Data=mass_addition_4.Result)  # -> Branch0, Branch1, Branch2, Branch3
equipment_kwh_m2a = Data(explode_tree_2.Branch2)
lighting_kwh_m2a = Data(explode_tree_2.Branch3)
cooling_kwh_m2a = Data(explode_tree_2.Branch0)
heating_kwh_m2a = Data(explode_tree_2.Branch1)

colibri_parameters = ColibriParameters(
    WWR=flatten(wwr_2),
    BLD=flatten(bld),
    Weather_Type=flatten(weather_type_2),
    EUI_kWh_m2a=flatten(mass_addition_3.EUIKWhM2a),
    Cooling_kWh_m2a=flatten(cooling_kwh_m2a),
    Heating_kWh_m2a=flatten(heating_kwh_m2a),
    Equipment_kWh_m2a=flatten(equipment_kwh_m2a),
    Lighting_kWh_m2a=flatten(lighting_kwh_m2a),
    OperationalCarbon_kg_CO2e_m2a=flatten(multiplication),
    EW_M2=flatten(area.EWM2),
    RO_M2=flatten(area_2.RO_M2),
    WI_M2=flatten(area_3.WI_M2),
    ES_M2=flatten(area_4.ES_M2),
    Volume_m3=flatten(mass_addition_2.VolumeM3),
    A_V=flatten(division_2))
colibri_aggregator = ColibriAggregator(
    Folder=panel,
    IterationGenomeID=colibri_iterator.Iteration_Genome,
    IterationPhenomeResults=colibri_parameters,
    Write=boolean_toggle_2,
    recordingMode=3)

importepw = LBImportEPW(epw_file=downloadepw.epw_file)  # -> location, dry_bulb_temperature, dew_point_temperature, relative_humidity, wind_speed, wind_direction, direct_normal_rad, diffuse_horizontal_rad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; plug-in component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
humidityr = LBHumidityMetrics(dry_bulb=importepw.dry_bulb_temperature, rel_humid=importepw.dew_point_temperature)  # -> humid_ratio, enthalpy, wet_bulb, dew_point; plug-in component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
entwine_4 = Entwine(
    Branch00=importepw.dry_bulb_temperature,
    Branch01=importepw.dew_point_temperature,
    Branch02=importepw.relative_humidity,
    Branch03=humidityr.humid_ratio,
    Branch04=importepw.wind_speed,
    Branch05=importepw.direct_normal_rad,
    Branch06=importepw.total_sky_cover,
    FlattenInputs=True)
xdata_2 = LBDeconstructData(data=entwine_4)  # -> header, values; plug-in component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
average = Average(Input=xdata_2.values)
hdd_cdd = LBDegreeDays(dry_bulb=importepw.dry_bulb_temperature, heat_base=Slider(18, range=0..100), cool_base=Slider(26, range=0..100))  # -> hourly_heat, hourly_cool, heat_deg_days, cool_deg_days; plug-in component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
explode_tree_3 = ExplodeTree(Data=average)  # -> Branch0, Branch1, Branch2, Branch3, Branch4, Branch5, Branch6
explode_tree_4 = ExplodeTree(Data=xdata_2.values)
entwine_5 = Entwine(
    Branch00=Slider(26, range=0..100),
    Branch01=Slider(29, range=0..100),
    Branch02=Slider(32, range=0..100),
    Branch03=Slider(35, range=0..100),
    FlattenInputs=True)
entwine_6 = Entwine(
    Branch00=Slider(18, range=0..100),
    Branch01=Slider(15, range=0..100),
    Branch02=Slider(12, range=0..100),
    Branch03=Slider(9, range=0..100),
    FlattenInputs=True)
larger_than = LargerThan(FirstNumber=explode_tree_4, SecondNumber=entwine_5)  # -> LargerThan, OrEqualTo
smaller_than = SmallerThan(FirstNumber=explode_tree_4, SecondNumber=entwine_6)  # -> SmallerThan, OrEqualTo
mass_addition_5 = MassAddition(Input=larger_than.LargerThan)  # -> Result, PartialResults
mass_addition_6 = MassAddition(Input=smaller_than.SmallerThan)  # -> Result, PartialResults
division_3 = Division(A=hdd_cdd.cool_deg_days, B=87.6)
division_4 = Division(A=mass_addition_5.Result, B=87.6)
division_5 = Division(A=mass_addition_6.Result, B=87.6)
division_6 = Division(A=hdd_cdd.heat_deg_days, B=87.6)
explode_tree_5 = ExplodeTree(Data=division_4)  # -> Branch0, Branch1, Branch2, Branch3
explode_tree_6 = ExplodeTree(Data=division_5)  # -> Branch0, Branch1, Branch2, Branch3
avg_db_temp_c = Data(explode_tree_3.Branch0)
avg_dp_temp_c = Data(explode_tree_3.Branch1)
avg_win_sp_m_s = Data(explode_tree_3.Branch4)
avg_sr_wh_m2 = Data(explode_tree_3.Branch5)
avg_hr_kg_kg = Data(explode_tree_3.Branch3)
avg_rh = Data(explode_tree_3.Branch2)
t_26 = Data(explode_tree_5.Branch0)
t_29 = Data(explode_tree_5.Branch1)
t_35 = Data(explode_tree_5.Branch3)
t_18 = Data(explode_tree_6.Branch0)
t_15 = Data(explode_tree_6.Branch1)
t_32 = Data(explode_tree_5.Branch2)
t_12 = Data(explode_tree_6.Branch2)
hdd = Data(division_6)
cdd = Data(division_3)
t_9 = Data(explode_tree_6.Branch3)

division_7 = Division(A=explode_tree_3.Branch6, B=0.1)

avg_sc = Data(division_7)

# ==== cluster Cluster_3
data = ClusterInput()
explode_tree = ExplodeTree(Data=data)  # -> Branch0, Branch1, Branch2, Branch3, Branch4, Branch5
cluster = Cluster_2(u_factor=explode_tree.Branch3, shgc=explode_tree.Branch4, t_vis=explode_tree.Branch5)
cluster_2 = Cluster(B=explode_tree.Branch1)
cluster_3 = Cluster(B=explode_tree.Branch0)
cluster_4 = Cluster(B=explode_tree.Branch2)
constr = ClusterOutput(cluster_2)
constr_2 = ClusterOutput(cluster_3)
constr_3 = ClusterOutput(cluster_4)
constr_4 = ClusterOutput(cluster)

# ==== cluster Cluster
B = ClusterInput()
division = Division(A=1, B=B)
opaquematnomass = HBOpaqueMaterialNoMass(r_value=division)  # -> mat; plug-in component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
opaqueconstr = HBOpaqueConstruction(materials=opaquematnomass)  # -> constr; plug-in component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
constr = ClusterOutput(opaqueconstr)

# ==== cluster Cluster_2
u_factor = ClusterInput()
shgc = ClusterInput()
t_vis = ClusterInput()
windowmat = HBWindowMaterial(u_factor=u_factor, shgc=shgc, t_vis=t_vis)  # -> mat; plug-in component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
windowconstr = HBWindowConstruction(materials=windowmat)  # -> constr; plug-in component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
constr = ClusterOutput(windowconstr)
