# Grasshopper definition Energy_Model_Export.gh (Grasshopper 1.0.8)

# Here the name of the Iteration
# is to be used. Same as .csv name.
# Here the predefined signal to save
# obj or ifc is to beconnected.
panel = Panel("C:\Users\User\Documents\IAAC\Module03\BDG\Export")
# Here the outputs from
# Surfaces (Roof, Floors)
#  is to be plugged.
model_name = Data()
folder_name = Data(panel)
save_iterator = Data()
brep = Brep([<brep referenced from the Rhino model> x6])
cluster = Cluster(floors_roofs=brep, model_name=model_name, folder_name=folder_name, save_iterator=save_iterator)

# ==== cluster Cluster
floors_roofs = ClusterInput()
model_name = ClusterInput()
folder_name = ClusterInput()
save_iterator = ClusterInput()
floors_roofs_2 = Brep(flatten(floors_roofs))
brep_join = BrepJoin(Breps=floors_roofs_2)  # -> Breps, Closed
unit_z = UnitZ(Factor=3)
merge_faces = MergeFaces(Brep=brep_join.Breps)  # -> Breps, Before, After
extrude = Extrude(Base=merge_faces.Breps, Direction=unit_z)
roomsolid = HBRoomFromSolid(geo=flatten(extrude), conditioned=True)  # -> out, rooms; plug-in component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
save_iterator_2 = Data(save_iterator)
model_name_2 = Data(model_name)
folder_name_2 = Data(folder_name)
model = HBModel(rooms=flatten(roomsolid.rooms), name=model_name_2)  # -> out, model; plug-in component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
dumpobjects = HBDumpObjects(hb_objs=flatten(model.model), name=model_name_2, folder=folder_name_2, dump=save_iterator_2)  # -> out, hb_file; plug-in component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
