# Grasshopper definition Energy_Sim.gh (Grasshopper 1.0.8)
# plug-ins: Pufferfish, SliderRemote, LunchBox, Colibri

wwr = Slider(3, range=0..3)
energystandard = Slider(0, range=0..1)
weather = Slider(0, range=0..6)
hb_climate_zones = HBClimateZones({"1 - Very Hot": "1", "2 - Hot": "2", "3 - Warm": "3", "4 - Mixed": "4", "5 - Cool": "5", "6 - Cold": "6", "7 - Very Cold": "7", "8 - Subarctic": "8"}, selected=["1 - Very Hot", "2 - Hot", "3 - Warm", "4 - Mixed", "5 - Cool", "6 - Cold", "7 - Very Cold"])

list_length = ListLength(List=hb_climate_zones)
x_minus_one = XMinusOne(NumberX=list_length)
slider_remote_control = SliderRemoteControl(SilderName="Weather", MinimumValue=0, MaximumValue=x_minus_one)

# ---- group: WWR_Ranges and Control
number_slider = Slider(0, range=0..100)
number_slider_2 = Slider(4, range=0..10)
x_minus_one_2 = XMinusOne(NumberX=number_slider_2)
data = Data("WWR")
division = Division(A=Slider(0.9, range=0..1), B=number_slider_2)
series = Series(Start=number_slider, Step=division, Count=number_slider_2)
slider_remote_control_2 = SliderRemoteControl(SilderName=graft(data), MinimumValue=number_slider, MaximumValue=x_minus_one_2)

# ----
hot_humid = Panel("https://energyplus-weather.s3.amazonaws.com/southwest_pacific_wmo_region_5/SGP/SGP_Singapore.486980_IWEC/SGP_Singapore.486980_IWEC.zip")
hot_dry = Panel("https://climate.onebuilding.org/WMO_Region_2_Asia/ARE_United_Arab_Emirates/ARE_DU_Dubai.Intl.AP.411940_TMYx.zip")
warmmarine = Panel("https://climate.onebuilding.org/WMO_Region_5_Southwest_Pacific/AUS_Australia/NSW_New_South_Wales/AUS_NSW_Sydney.Obs-Observatory.Hill.947680_TMYx.zip")
cold = Panel("https://climate.onebuilding.org/WMO_Region_6_Europe/SWE_Sweden/ST_Stockholm/SWE_ST_Stockholm.024850_TMYx.zip")
verycold_arctic = Panel("https://climate.onebuilding.org/WMO_Region_6_Europe/ISL_Iceland/HO_Capital/ISL_HO_Reykjavik.AP.040300_TMYx.zip")
mixed_humid = Panel("https://climate.onebuilding.org/WMO_Region_4_North_and_Central_America/USA_United_States_of_America/NY_New_York/USA_NY_New.York-Downtown.Manhattan.Heli.720553_TMYx.zip")
cool_humid = Panel("https://climate.onebuilding.org/WMO_Region_6_Europe/DEU_Germany/BE_Berlin/DEU_BE_Berlin-Tegel.AP.103820_TMYx.zip")

hb_building_vintages = HBBuildingVintages({"ASHRAE 90.1 2019  |  IECC 2021": "2019", "ASHRAE 90.1 2016  |  IECC 2018": "2016", "ASHRAE 90.1 2013  |  IECC 2015": "2013", "ASHRAE 90.1 2010  |  IECC 2012": "2010", "ASHRAE 90.1 2007  |  IECC 2009": "2007", "ASHRAE 90.1 2004  |  IECC 2006": "2004", "1980-2004 (CBECS)": "1980_2004", "Pre-1980 (CBECS)": "pre_1980"}, selected="ASHRAE 90.1 2019  |  IECC 2021")
hb_construction_types = HBConstructionTypes({"SteelFramed", "WoodFramed", "Mass", "Metal Building"}, selected="Mass")
list_item = ListItem(List=hb_climate_zones, Index=weather, Wrap=True)
constrsetclimate = HBConstructionSetByClimate(climate_zone=list_item, vintage=hb_building_vintages, constr_type=hb_construction_types)  # -> constr_set; plug-in component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

list_item_2 = ListItem(List=series, Index=wwr, Wrap=True)
list_item_3 = ListItem(List=series, Index=wwr, Wrap=True)
list_item_4 = ListItem(List=series, Index=wwr, Wrap=True)
list_item_5 = ListItem(List=series, Index=wwr, Wrap=True)
wwr_w = Data(list_item_3)
wwr_n = Data(list_item_4)
wwr_s = Data(list_item_2)
wwr_e = Data(list_item_5)
facparam = HBFacadeParameters(north=wwr_n, east=wwr_e, south=wwr_s, west=wwr_w)  # -> fac_par; plug-in component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
wwr_2 = Data(wwr_n)

file_path = FilePath("C:\Users\User\Documents\IAAC\Module03\BDG\Export\50_70_0_12_3000_3000_True_0.3_36_25_40_20.hbjson")
loadobjects = HBLoadObjects(hb_file=file_path, load=Toggle(True))  # -> out, hb_objs; plug-in component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

x_minus_one_3 = XMinusOne(NumberX=list_item)
weather_type = Panel("""1A–VeryHot_Humid
2B–Hot_Dry
3C–Warm_Marine
4A–Mixed_Humid
5A–Cool_Humid
6A_Cold
7/8–Very_Cold/Arctic""")
stream_filter = StreamFilter(
    Gate=x_minus_one_3,
    Stream0=hot_humid,
    Stream1=hot_dry,
    Stream2=warmmarine,
    Stream3=mixed_humid,
    Stream4=cool_humid,
    Stream5=cold,
    Stream6=verycold_arctic)
downloadepw = LBDownloadWeather(weather_URL=stream_filter)  # -> epw_file, stat_file, ddy_file; plug-in component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
list_item_6 = ListItem(List=weather_type, Index=x_minus_one_3, Wrap=True)
weather_type_2 = Data(list_item_6)

file_path_2 = FilePath("C:\Users\User\Documents\IAAC\Module03\Encoding\Weather\U-Values.csv")
read_file = ReadFile(File=file_path_2, PerLineParse=True)
read_csv = ReadCSV(CSVString=read_file, Delimiter=",", DataStruct=False)  # -> Headers, Values
panel = Panel(read_csv.Headers)
panel_2 = Panel(read_csv.Values)
list_item_7 = ListItem(List=read_csv.Values, Index=x_minus_one_3, Wrap=True)
explode_tree = ExplodeTree(Data=list_item_7)  # -> Branch0, Branch1, Branch2, Branch3, Branch4, Branch5, Branch6, Branch7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
entwine = Entwine(
    Branch00=explode_tree.Branch2,
    Branch01=explode_tree.Branch4,
    Branch02=explode_tree.Branch6,
    Branch03=explode_tree.Branch8,
    Branch04=explode_tree.Branch10,
    Branch05=explode_tree.Branch12,
    FlattenInputs=True)
entwine_2 = Entwine(
    Branch00=explode_tree.Branch1,
    Branch01=explode_tree.Branch3,
    Branch02=explode_tree.Branch5,
    Branch03=explode_tree.Branch7,
    Branch04=explode_tree.Branch9,
    Branch05=explode_tree.Branch11,
    FlattenInputs=True)
stream_filter_2 = StreamFilter(Gate=energystandard, Stream0=entwine, Stream1=entwine_2)

deconstructmodel = HBDeconstructModel(model=loadobjects.hb_objs)  # -> rooms, faces, apertures, doors, shades; plug-in component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
boolean_toggle = BooleanToggle(True)
intsolid = HBIntersectSolids(rooms=flatten(deconstructmodel.rooms), run=boolean_toggle)  # -> int_rooms; plug-in component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
solveadj = HBSolveAdjacency(rooms=flatten(intsolid), adiabatic=Toggle(True), run=boolean_toggle)  # -> out, adj_rooms; plug-in component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
aperturesbyratio = HBAperturesByRatio(hb_objs=flatten(solveadj.adj_rooms), ratio=facparam)  # -> out, hb_objs; plug-in component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

cluster = Cluster_3(data=stream_filter_2)  # -> constr_3, constr_2, constr_4, constr
exteriorsubset = HBExteriorConstructionSubset(exterior_wall=cluster.constr_2, exterior_roof=cluster.constr_4, exposed_floor=cluster.constr_3)  # -> exterior_set; plug-in component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
subfacesubset = HBSubfaceSubset(window=cluster.constr)  # -> subface_set; plug-in component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
groundsubset = HBGroundConstructionSubset(ground_floor=cluster.constr_3)  # -> ground_set; plug-in component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
constructionset = HBConstructionSet(
    base_constr_set=constrsetclimate,
    exterior_subset=exteriorsubset,
    ground_subset=groundsubset,
    subface_subset=subfacesubset)  # -> constr_set; plug-in component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

# ---- group: Shading or not
externalshading = Slider(0, range=0..1)  # disabled

# ----
externalshadingon = BooleanToggle(True)  # disabled
externalshadingoff = BooleanToggle(False)  # disabled
stream_filter_3 = StreamFilter(Gate=externalshading, Stream0=externalshadingoff, Stream1=externalshadingon)  # disabled

number_slider_3 = Slider(0.2, range=0.1..0.5)  # disabled
number_slider_4 = Slider(0.05, range=0..0.1)  # disabled
number_slider_5 = Slider(10, range=0..10)  # disabled
bordershades = HBExtrudedBorderShades(hb_objs=flatten(aperturesbyratio.hb_objs), depth=number_slider_3)  # -> out, hb_objs; disabled; plug-in component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
louvershades = HBLouverShades(hb_objs=flatten(bordershades.hb_objs), depth=number_slider_4, shade_count=number_slider_5)  # -> readMe, hb_objs; disabled; plug-in component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
stream_filter_4 = StreamFilter(Gate=stream_filter_3, Stream0=bordershades.hb_objs, Stream1=louvershades.hb_objs)  # disabled

boolean_toggle_2 = BooleanToggle(True)
number_slider_6 = Slider(0.75, range=0..1)
hb_all_air_hvac_templates = HBAllAirHVACTemplates({"VAV chiller with gas boiler reheat": "VAV_Chiller_Boiler", "VAV chiller with central air source heat pump reheat": "VAV_Chiller_ASHP", "VAV chiller with district hot water reheat": "VAV_Chiller_DHW", "VAV chiller with PFP boxes": "VAV_Chiller_PFP", "VAV chiller with gas coil reheat": "VAV_Chiller_GasCoil", "VAV air-cooled chiller with gas boiler reheat": "VAV_ACChiller_Boiler", "VAV air-cooled chiller with central air source heat pump reheat": "VAV_ACChiller_ASHP", "VAV air-cooled chiller with district hot water reheat": "VAV_ACChiller_DHW", "VAV air-cooled chiller with PFP boxes": "VAV_ACChiller_PFP", "VAV air-cooled chiller with gas coil reheat": "VAV_ACChiller_GasCoil"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}, selected="VAV air-cooled chiller with central air source heat pump reheat")
hb_doas_hvac_templates = HBDOASHVACTemplates({"DOAS with fan coil chiller with boiler": "DOAS_FCU_Chiller_Boiler", "DOAS with fan coil chiller with central air source heat pump": "DOAS_FCU_Chiller_ASHP", "DOAS with fan coil chiller with district hot water": "DOAS_FCU_Chiller_DHW", "DOAS with fan coil chiller with baseboard electric": "DOAS_FCU_Chiller_ElectricBaseboard", "DOAS with fan coil chiller with gas unit heaters": "DOAS_FCU_Chiller_GasHeaters", "DOAS with fan coil chiller with no heat": "DOAS_FCU_Chiller", "DOAS with fan coil air-cooled chiller with boiler": "DOAS_FCU_ACChiller_Boiler", "DOAS with fan coil air-cooled chiller with central air source heat pump": "DOAS_FCU_ACChiller_ASHP", "DOAS with fan coil air-cooled chiller with district hot water": "DOAS_FCU_ACChiller_DHW", "DOAS with fan coil air-cooled chiller with baseboard electric": "DOAS_FCU_ACChiller_ElectricBaseboard"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}, selected="DOAS with fan coil air-cooled chiller with central air source heat pump")
hb_heatcool_hvac_templates = HBHeatCoolHVACTemplates({"Baseboard electric": "ElectricBaseboard", "Baseboard gas boiler": "BoilerBaseboard", "Baseboard central air source heat pump": "ASHPBaseboard", "Baseboard district hot water": "DHWBaseboard", "Direct evap coolers with baseboard electric": "EvapCoolers_ElectricBaseboard", "Direct evap coolers with baseboard gas boiler": "EvapCoolers_BoilerBaseboard"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}, selected="Residential AC with baseboard central air source heat pump": "ResidentialAC_ASHPBaseboard")
value_list = ValueList({"Ideal HVAC": 0, "VAV_ACChiller_ASHP": 1, "DOAS_FCU_ACChiller_ASHP": 2, "ResidentialAC_ASHPBaseboard": 3}, selected="Ideal HVAC")
hvac = Slider(0, range=0..1)
panel_3 = Panel(["Ideal HVAC", hb_all_air_hvac_templates, hb_doas_hvac_templates, hb_heatcool_hvac_templates])
doashvac = HBDOASHVAC(
    rooms=flatten(aperturesbyratio.hb_objs),
    system_type=hb_doas_hvac_templates,
    sensible_hr=number_slider_6,
    latent_hr=number_slider_6,
    dcv=boolean_toggle_2)  # -> out, rooms; plug-in component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
idealair = HBIdealAir(
    rooms=flatten(aperturesbyratio.hb_objs),
    economizer="DifferentialDryBulb",
    dcv=boolean_toggle_2,
    sensible_hr=number_slider_6,
    latent_hr=number_slider_6)  # -> out, rooms; plug-in component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
heatcoolhvac = HBHeatCoolHVAC(rooms=flatten(aperturesbyratio.hb_objs), system_type=hb_heatcool_hvac_templates)  # -> out, rooms; plug-in component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
allairhvac = HBAllAirHVAC(
    rooms=flatten(aperturesbyratio.hb_objs),
    system_type=hb_all_air_hvac_templates,
    economizer="DifferentialDryBulb",
    sensible_hr=number_slider_6,
    latent_hr=number_slider_6,
    dcv=boolean_toggle_2)  # -> out, rooms; plug-in component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
list_item_8 = ListItem(List=value_list, Index=hvac, Wrap=True)
list_item_9 = ListItem(List=panel_3, Index=list_item_8, Wrap=True)
hvac_name = Data(list_item_9)
stream_filter_5 = StreamFilter(Gate=list_item_8, Stream0=idealair.rooms, Stream1=allairhvac.rooms, Stream2=doashvac.rooms, Stream3=heatcoolhvac.rooms)

list_length_2 = ListLength(List=value_list)
x_minus_one_4 = XMinusOne(NumberX=list_length_2)
slider_remote_control_3 = SliderRemoteControl(SilderName="HVAC", MinimumValue=0, MaximumValue=x_minus_one_4)

applyconstrset = HBApplyConstructionSet(rooms=stream_filter_5, constr_set=constructionset)  # -> rooms; plug-in component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

# ---- group: kg CO₂e per kWh
worldwide_average_electricity_emission_f = Panel("0.45")  # "Worldwide Average Electricity Emission Factor"

# ----
annualloads = HBAnnualLoads(rooms=flatten(applyconstrset), epw_file=downloadepw.epw_file, run=Toggle(True))  # -> out, total_load, cooling, heating, lighting, equip, process, hot_water, balance; plug-in component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
mass_addition = MassAddition(Input=annualloads.total_load)  # -> EUIKWhM2a, PartialResults
multiplication = Multiplication(A=mass_addition.EUIKWhM2a, B=worldwide_average_electricity_emission_f)

vizbytype = HBVisualizeByType(hb_objs=aperturesbyratio.hb_objs)  # -> walls, interior_walls, roofs, ceilings, exterior_floors, interior_floors, air_walls, apertures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; plug-in component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
mesh = Mesh(vizbytype.walls)
mesh_2 = Mesh(vizbytype.roofs)
mesh_3 = Mesh(vizbytype.apertures)
area = Area(Geometry=mesh)  # -> EW_M2, Centroid
area_2 = Area(Geometry=mesh_2)  # -> RO_M2, Centroid
area_3 = Area(Geometry=mesh_3)  # -> WI_M2, Centroid

panel_4 = Panel("C:\Users\User\Documents\IAAC\Module03\Encoding\Energy\Export")
colibri_parameters = ColibriParameters(
    WWR=flatten(wwr_2),
    Weather_Type=flatten(weather_type_2),
    EUI_kWh_m2a=flatten(mass_addition.EUIKWhM2a),
    OperationalCarbon_kg_CO2e_m2a=flatten(multiplication),
    EW_M2=flatten(area.EW_M2),
    RO_M2=flatten(area_2.RO_M2),
    WI_M2=flatten(area_3.WI_M2))
colibri_iterator = ColibriIterator(WWR=wwr, Weather=weather, EnergyStandard=energystandard, RemoteFly=False, ignoreAllWarningMsg=False)  # -> WWR, Weather, EnergyStandard, Iteration_Genome
colibri_aggregator = ColibriAggregator(
    Folder=panel_4,
    IterationGenomeID=colibri_iterator.Iteration_Genome,
    IterationPhenomeResults=colibri_parameters,
    Write=Toggle(False),
    recordingMode=3)

# ==== cluster Cluster_3
data = ClusterInput()
explode_tree = ExplodeTree(Data=data)  # -> Branch0, Branch1, Branch2, Branch3, Branch4, Branch5
cluster = Cluster_2(u_factor=explode_tree.Branch3, shgc=explode_tree.Branch4, t_vis=explode_tree.Branch5)
constr = ClusterOutput(cluster)
cluster_2 = Cluster(B=explode_tree.Branch1)
constr_2 = ClusterOutput(cluster_2)
cluster_3 = Cluster(B=explode_tree.Branch0)
constr_3 = ClusterOutput(cluster_3)
cluster_4 = Cluster(B=explode_tree.Branch2)
constr_4 = ClusterOutput(cluster_4)

# ==== cluster Cluster
B = ClusterInput()
division = Division(A=1, B=B)
opaquematnomass = HBOpaqueMaterialNoMass(r_value=division)  # -> mat; plug-in component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
opaqueconstr = HBOpaqueConstruction(materials=opaquematnomass)  # -> constr; plug-in component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
constr = ClusterOutput(opaqueconstr)

# ==== cluster Cluster_2
u_factor = ClusterInput()
shgc = ClusterInput()
t_vis = ClusterInput()
windowmat = HBWindowMaterial(u_factor=u_factor, shgc=shgc, t_vis=t_vis)  # -> mat; plug-in component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
windowconstr = HBWindowConstruction(materials=windowmat)  # -> constr; plug-in component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
constr = ClusterOutput(windowconstr)
