# Grasshopper definition ML_Test.gh (Grasshopper 1.0.8)
# plug-ins: RhinoCodePluginGH

query_model_layers = QueryModelLayers(AutoUpdateState=True)
model_layer = ModelLayer(Layer=query_model_layers)  # -> Layer, Name, Hidden, Locked, DisplayColour, Material, Linetype
query_model_objects = QueryModelObjects(Layer=model_layer.Name, Locked=True, Hidden=True, AutoUpdateState=True)  # -> flatten(Objects)
brep = Brep(query_model_objects)
solid_union = SolidUnion(Breps=brep)
deconstruct_brep = DeconstructBrep(Brep=solid_union)  # -> flatten(Faces), Edges, Vertices
box_properties = BoxProperties(Box=solid_union)  # -> Center, Diagonal, Area, Volume, Degeneracy
area = Area(Geometry=deconstruct_brep.Faces)  # -> Area, Centroid
mass_addition = MassAddition(Input=box_properties.Volume)  # -> Result, PartialResults
mass_addition_2 = MassAddition(Input=area.Area)  # -> Result, PartialResults
division = Division(A=mass_addition.Result, B=3)
division_2 = Division(A=mass_addition_2.Result, B=mass_addition.Result)

wwr = Slider(0.6, range=0.1..0.9)

ew_ins = ValueList({"CEL": 0, "COR": 1, "EPS": 2, "GLW": 3, "MIW": 4, "WOF": 5}, selected="WOF")
ew_par = ValueList({"BRI": 0, "CON": 1, "EAR": 2, "STR": 3, "TIF": 4, "TIM": 5}, selected="TIM")

iw_par = ValueList({"BRI": 0, "CON": 1, "EAR": 2, "STR": 3, "TIF": 4, "TIM": 5}, selected="TIM")
es_ins = ValueList({"EXG": 0, "XPS": 1}, selected="XPS")
is_par = ValueList({"CON": 0, "TIF": 1, "TIM": 2}, selected="TIF")
ro_par = ValueList({"CON": 0, "TIF": 1, "TIM": 2}, selected="TIM")
ro_ins = ValueList({"CEL": 0, "COR": 1, "EPS": 2, "EXG": 3, "GLW": 4, "MIW": 5, "WOF": 6, "XPS": 7}, selected="WOF")

ew_ins_2 = ValueList({"CEL": 0, "COR": 1, "EPS": 2, "GLW": 3, "MIW": 4, "WOF": 5}, selected="WOF")
ew_par_2 = ValueList({"BRI": 0, "CON": 1, "EAR": 2, "STR": 3, "TIF": 4, "TIM": 5}, selected="TIM")

iw_par_2 = ValueList({"BRI": 0, "CON": 1, "EAR": 2, "STR": 3, "TIF": 4, "TIM": 5}, selected="TIM")
es_ins_2 = ValueList({"EXG": 0, "XPS": 1}, selected="XPS")
is_par_2 = ValueList({"CON": 0, "TIF": 1, "TIM": 2}, selected="TIF")
ro_par_2 = ValueList({"CON": 0, "TIF": 1, "TIM": 2}, selected="TIM")
ro_ins_2 = ValueList({"CEL": 0, "COR": 1, "EPS": 2, "EXG": 3, "GLW": 4, "MIW": 5, "WOF": 6, "XPS": 7}, selected="WOF")

ew_ins_3 = ValueList({"CEL": 0, "COR": 1, "EPS": 2, "GLW": 3, "MIW": 4, "WOF": 5}, selected="WOF")
ew_par_3 = ValueList({"BRI": 0, "CON": 1, "EAR": 2, "STR": 3, "TIF": 4, "TIM": 5}, selected="TIM")

iw_par_3 = ValueList({"BRI": 0, "CON": 1, "EAR": 2, "STR": 3, "TIF": 4, "TIM": 5}, selected="TIM")
es_ins_3 = ValueList({"EXG": 0, "XPS": 1}, selected="XPS")
is_par_3 = ValueList({"CON": 0, "TIF": 1, "TIM": 2}, selected="TIF")
ro_par_3 = ValueList({"CON": 0, "TIF": 1, "TIM": 2}, selected="TIM")
ro_ins_3 = ValueList({"CEL": 0, "COR": 1, "EPS": 2, "EXG": 3, "GLW": 4, "MIW": 5, "WOF": 6, "XPS": 7}, selected="WOF")
load_av_gfa_model = FilePath("C:\Users\User\Downloads\gwp_model_rf_av&gfa.pkl")
load_av_model = FilePath("C:\Users\User\Downloads\gwp_model_rf (1).pkl")
load_gfa_model = FilePath("C:\Users\User\Downloads\gwp_model_rf.pkl")
python_3_script = Python3Script(
    model_path=load_av_gfa_model,
    ew_par=ew_par_2,
    ew_ins=ew_ins_2,
    iw_par=iw_par_2,
    es_ins=es_ins_2,
    is_par=is_par_2,
    ro_par=ro_par_2,
    ro_ins=ro_ins_2,
    wwr=wwr,
    av=division_2,
    gfa=division)  # -> out, graft(prediction), labeled_output; inputs wwr: Double, av: Double
# ---------- python_3_script: Python ----------
#r: joblib
#r: scikit-learn

import os
import joblib
import warnings

# Output placeholders
prediction = "⚠️ Could not predict"
labeled_output = []

# Default input values (adjusted: A/V replaces GFA)
defaults = {
    "ew_par": 0,
    "ew_ins": 0,
    "iw_par": 0,
    "es_ins": 1,
    "is_par": 0,
    "ro_par": 0,
    "ro_ins": 0,
    "wwr": 0.3,
    "av": 0.5,   
    "gfa":500
}

# Labels for the 7 predicted values
labels = [
    "EUI (kWh/m²a)",
    "Cooling (kWh/m²a)",
    "Heating (kWh/m²a)",
    "Operational Carbon (kg CO2e/m²a)",
    "A1-A3/m² (GFA)",
    "A-D/m² (GFA)",
    "GWP total/m²GFA"
]

# Assign default values if inputs are missing
try:
    ew_par = ew_par if 'ew_par' in globals() and ew_par is not None else defaults["ew_par"]
    ew_ins = ew_ins if 'ew_ins' in globals() and ew_ins is not None else defaults["ew_ins"]
    iw_par = iw_par if 'iw_par' in globals() and iw_par is not None else defaults["iw_par"]
    es_ins = es_ins if 'es_ins' in globals() and es_ins is not None else defaults["es_ins"]
    is_par = is_par if 'is_par' in globals() and is_par is not None else defaults["is_par"]
    ro_par = ro_par if 'ro_par' in globals() and ro_par is not None else defaults["ro_par"]
    ro_ins = ro_ins if 'ro_ins' in globals() and ro_ins is not None else defaults["ro_ins"]
    wwr = wwr if 'wwr' in globals() and wwr is not None else defaults["wwr"]
    av = av if 'av' in globals() and av is not None else defaults["av"]
    gfa = gfa if 'gfa' in globals() and gfa is not None else defaults["gfa"]
except:
    prediction = "⚠️ Error applying default inputs"

# Load model and predict
try:
    if "loaded_model" not in globals():
        if os.path.exists(model_path):
            loaded_model = joblib.load(model_path)
        else:
            prediction = f"⚠️ Model not found: {model_path}"

    input_row = [[ew_par, ew_ins, iw_par, es_ins, is_par, ro_par, ro_ins, wwr, av, gfa]]

    with warnings.catch_warnings():
        warnings.simplefilter("ignore")
        output = loaded_model.predict(input_row)[0]

    prediction = list(output)
    labeled_output = [f"{label}: {value:.2f}" for label, value in zip(labels, prediction)]

except Exception as e:
    prediction = f"⚠️ Prediction failed: {str(e)}"
    labeled_output = []
# ---------- end python_3_script ----------
python_3_script_2 = Python3Script(
    model_path=load_av_model,
    ew_par=ew_par_2,
    ew_ins=ew_ins_2,
    iw_par=iw_par_2,
    es_ins=es_ins_2,
    is_par=is_par_2,
    ro_par=ro_par_2,
    ro_ins=ro_ins_2,
    wwr=wwr,
    av=division_2)  # -> out, graft(prediction), labeled_output; inputs wwr: Double, av: Double
# ---------- python_3_script_2: Python ----------
#r: joblib
#r: scikit-learn

import os
import joblib
import warnings

# Output placeholders
prediction = "⚠️ Could not predict"
labeled_output = []

# Default input values (adjusted: A/V replaces GFA)
defaults = {
    "ew_par": 0,
    "ew_ins": 0,
    "iw_par": 0,
    "es_ins": 1,
    "is_par": 0,
    "ro_par": 0,
    "ro_ins": 0,
    "wwr": 0.3,
    "av": 0.5   # default A/V ratio
}

# Labels for the 7 predicted values
labels = [
    "EUI (kWh/m²a)",
    "Cooling (kWh/m²a)",
    "Heating (kWh/m²a)",
    "Operational Carbon (kg CO2e/m²a)",
    "A1-A3/m² (GFA)",
    "A-D/m² (GFA)",
    "GWP total/m²GFA"
]

# Assign default values if inputs are missing
try:
    ew_par = ew_par if 'ew_par' in globals() and ew_par is not None else defaults["ew_par"]
    ew_ins = ew_ins if 'ew_ins' in globals() and ew_ins is not None else defaults["ew_ins"]
    iw_par = iw_par if 'iw_par' in globals() and iw_par is not None else defaults["iw_par"]
    es_ins = es_ins if 'es_ins' in globals() and es_ins is not None else defaults["es_ins"]
    is_par = is_par if 'is_par' in globals() and is_par is not None else defaults["is_par"]
    ro_par = ro_par if 'ro_par' in globals() and ro_par is not None else defaults["ro_par"]
    ro_ins = ro_ins if 'ro_ins' in globals() and ro_ins is not None else defaults["ro_ins"]
    wwr = wwr if 'wwr' in globals() and wwr is not None else defaults["wwr"]
    av = av if 'av' in globals() and av is not None else defaults["av"]
except:
    prediction = "⚠️ Error applying default inputs"

# Load model and predict
try:
    if "loaded_model" not in globals():
        if os.path.exists(model_path):
            loaded_model = joblib.load(model_path)
        else:
            prediction = f"⚠️ Model not found: {model_path}"

    input_row = [[ew_par, ew_ins, iw_par, es_ins, is_par, ro_par, ro_ins, wwr, av]]

    with warnings.catch_warnings():
        warnings.simplefilter("ignore")
        output = loaded_model.predict(input_row)[0]

    prediction = list(output)
    labeled_output = [f"{label}: {value:.2f}" for label, value in zip(labels, prediction)]

except Exception as e:
    prediction = f"⚠️ Prediction failed: {str(e)}"
    labeled_output = []
# ---------- end python_3_script_2 ----------
python_3_script_3 = Python3Script(
    model_path=load_gfa_model,
    ew_par=ew_par_2,
    ew_ins=ew_ins_2,
    iw_par=iw_par_2,
    es_ins=es_ins_2,
    is_par=is_par_2,
    ro_par=ro_par_2,
    ro_ins=ro_ins_2,
    wwr=wwr,
    gfa=division)  # -> out, graft(prediction), labeled_output; inputs wwr: Double
# ---------- python_3_script_3: Python ----------
#r: joblib
#r: scikit-learn

import os
import joblib
import warnings

# Output placeholder
prediction = "⚠️ Could not predict"
labeled_output = []

# Default input values
defaults = {
    "ew_par": 0,
    "ew_ins": 0,
    "iw_par": 0,
    "es_ins": 1,
    "is_par": 0,
    "ro_par": 0,
    "ro_ins": 0,
    "wwr": 0.3,
    "gfa": 200.0
}

# Define prediction labels
labels = [
    "EUI (kWh/m²a)",
    "Cooling (kWh/m²a)",
    "Heating (kWh/m²a)",
    "Operational Carbon (kg CO2e/m²a)",
    "A1-A3/m² (GFA)",
    "A-D/m² (GFA)",
    "GWP total/m²GFA"
]

# Assign default values if needed
try:
    ew_par = ew_par if 'ew_par' in globals() and ew_par is not None else defaults["ew_par"]
    ew_ins = ew_ins if 'ew_ins' in globals() and ew_ins is not None else defaults["ew_ins"]
    iw_par = iw_par if 'iw_par' in globals() and iw_par is not None else defaults["iw_par"]
    es_ins = es_ins if 'es_ins' in globals() and es_ins is not None else defaults["es_ins"]
    is_par = is_par if 'is_par' in globals() and is_par is not None else defaults["is_par"]
    ro_par = ro_par if 'ro_par' in globals() and ro_par is not None else defaults["ro_par"]
    ro_ins = ro_ins if 'ro_ins' in globals() and ro_ins is not None else defaults["ro_ins"]
    wwr = wwr if 'wwr' in globals() and wwr is not None else defaults["wwr"]
    gfa = gfa if 'gfa' in globals() and gfa is not None else defaults["gfa"]
except:
    prediction = "⚠️ Error applying default inputs"

# Load model and predict
try:
    if "loaded_model" not in globals():
        if os.path.exists(model_path):
            loaded_model = joblib.load(model_path)
        else:
            prediction = f"⚠️ Model not found: {model_path}"

    input_row = [[ew_par, ew_ins, iw_par, es_ins, is_par, ro_par, ro_ins, wwr, gfa]]

    with warnings.catch_warnings():
        warnings.simplefilter("ignore")
        output = loaded_model.predict(input_row)[0]

    prediction = list(output)
    labeled_output = [f"{label}: {value:.2f}" for label, value in zip(labels, prediction)]

except Exception as e:
    prediction = f"⚠️ Prediction failed: {str(e)}"
    labeled_output = []
# ---------- end python_3_script_3 ----------
panel = Panel(python_3_script.labeled_output)
panel_2 = Panel(division_2)
panel_3 = Panel(python_3_script_3.labeled_output)
panel_4 = Panel(python_3_script_2.labeled_output)
gfa = Panel(division)
