# Grasshopper definition llm_gh.gh (Grasshopper 1.0.8)
# plug-ins: Moonlight

moonlight = Moonlight(Mode=True)
prompt = Panel("")
llm_message = Python3Script(input_text=prompt, run=Toggle(True), reset=Button())  # -> out, out_2, state_output, design_data_json
# ---------- llm_message: Python ----------
"""
Conversation State Component for Grasshopper - With Reset Button
"""
import sys
import os

# Define file paths to store state between runs
temp_dir = os.path.join(os.environ['TEMP'], 'gh_design_assistant')
state_file = os.path.join(temp_dir, 'current_state.txt')
design_data_file = os.path.join(temp_dir, 'design_data.json')

# Create temp directory if it doesn't exist
if not os.path.exists(temp_dir):
    os.makedirs(temp_dir)

# Initialize outputs
out = "Ready to connect"
state_output = "initial"  # Default state
design_data_json = "{}"

# Read saved state and design data if they exist
def load_saved_state():
    try:
        if os.path.exists(state_file):
            with open(state_file, 'r') as f:
                saved_state = f.read().strip()
        else:
            saved_state = "initial"
            
        if os.path.exists(design_data_file):
            with open(design_data_file, 'r') as f:
                saved_data = f.read()
        else:
            saved_data = "{}"
            
        return saved_state, saved_data
    except Exception as e:
        print(f"Error loading saved state: {str(e)}")
        return "initial", "{}"

# Save state and design data for next run
def save_state(state, data):
    try:
        with open(state_file, 'w') as f:
            f.write(state)
        with open(design_data_file, 'w') as f:
            f.write(data)
        print(f"Saved state: {state}")
    except Exception as e:
        print(f"Error saving state: {str(e)}")

# Delete state files to reset
def reset_state():
    try:
        if os.path.exists(state_file):
            os.remove(state_file)
        if os.path.exists(design_data_file):
            os.remove(design_data_file)
        print("Conversation state reset")
        return True
    except Exception as e:
        print(f"Error resetting state: {str(e)}")
        return False

# Check if reset is requested
if reset:
    reset_success = reset_state()
    out = "Conversation has been reset. Start a new design." if reset_success else "Error resetting conversation."
    state_output = "initial"
    design_data_json = "{}"
    
# Otherwise, proceed with normal operation
elif run:
    # Load saved state first (unless we're resetting)
    current_state_value, current_design_data_json = load_saved_state()
    print(f"Loaded state: {current_state_value}")
    
    try:
        # Make sure we have necessary libraries
        try:
            import requests
            import json
            print("✓ Required libraries are available")
        except ImportError as e:
            out = f"ERROR: Required library not installed: {str(e)}"
            import sys
            sys.exit(0)
        
        # Define the URL
        url = "http://127.0.0.1:5000/llm_message"
        
        # Parse current design data
        try:
            if current_design_data_json and current_design_data_json.strip() != "":
                design_data = json.loads(current_design_data_json)
            else:
                design_data = {}
        except Exception as e:
            print(f"Error parsing design data: {str(e)}")
            design_data = {}
            
        # Prepare the payload
        payload = {
            "input": input_text,
            "state": current_state_value,
            "design_data": design_data
        }
        
        print(f"Connecting to: {url}")
        print(f"Current state: {current_state_value}")
        print(f"Input: {input_text}")
        
        # Make the request with increased timeout
        response = requests.post(url, json=payload, timeout=10)
        
        # Check if request was successful
        if response.status_code == 200:
            data = response.json()
            out = data.get('response', 'No response received')
            state_output = data.get('state', current_state_value)
            design_data_json = json.dumps(data.get('design_data', {}), indent=2)
            
            # Save the new state and design data for the next run
            save_state(state_output, design_data_json)
            
            print(f"Response received: {out[:50]}...")
            print(f"New state: {state_output}")
        else:
            out = f"Error: Server returned status code {response.status_code}"
            print(f"Server error: {response.text}")
            
    except Exception as e:
        out = f"Connection error: {str(e)}"
        import traceback
        print(traceback.format_exc())
else:
    # If neither run nor reset is active, just show current state
    current_state_value, current_design_data_json = load_saved_state()
    out = "Toggle 'run' to connect or 'reset' to start over"
    state_output = current_state_value
    design_data_json = current_design_data_json

# Set the output variables
a = out
b = state_output
c = design_data_json
# ---------- end llm_message ----------
response = Panel(llm_message.out_2)
json = Panel(llm_message.design_data_json)
