# Grasshopper definition llm_requests.gh (Grasshopper 1.0.8)

toggle = BooleanToggle(True)  # disabled
panel = Panel("a building")  # disabled
toggle_2 = BooleanToggle(True)  # disabled
panel_2 = Panel("a building")  # disabled
py3 = Python3Script(input_text=panel, run=toggle)  # -> out, out_2; disabled
# ---------- py3: Python ----------
import requests

url = 'http://localhost:5000/llm_call'
payload = {'input': input_text}


out = None
if run:
    response = requests.post(url, json=payload)

    if response.status_code == 200:
        data = response.json()
        out = data['response']
    else:
        out = "Failed to connect:"

a = out
# ---------- end py3 ----------
llm_message = Python3Script(input_text="hello", run=Toggle(True))  # -> out, out_2
# ---------- llm_message: Python ----------
"""
GH Python Component to Send Input Text to LLM Server

This component sends user input to the Flask LLM server and receives the response.
It handles basic communication with the Flask server's /llm_message endpoint.

Inputs:
    input_text: Text input from the user (string)
    run: Boolean toggle to execute the request (True/False)

Outputs:
    out: Response from the LLM server (string)
"""
import json
import requests
import Rhino.Geometry as rg
import ghpythonlib.components as ghc

# Define the server URL
base_url = "http://localhost:5000"

# Initialize output
out = None

if run:
    try:
        # Prepare the payload with the input text
        payload = {
            'input': input_text,
            'state': 'initial',  # Start with initial state
            'design_data': {}    # Empty design data to start
        }
        
        # Send the request to the Flask server
        response = requests.post(f"{base_url}/llm_message", json=payload)
        
        # Check if the request was successful
        if response.status_code == 200:
            data = response.json()
            out = data['response']
            
            # Store the state and design data for future use
            # In a real implementation, you would need to maintain state between calls
            # This could be done with global variables or by storing in a file
            
            # Print debugging info
            print(f"New state: {data.get('state', 'unknown')}")
            print(f"Design data: {json.dumps(data.get('design_data', {}), indent=2)}")
        else:
            out = f"❌ Error: Server returned status code {response.status_code}"
            
    except Exception as e:
        out = f"🔴 Error: {str(e)}"
else:
    out = "Run toggle is off. Switch on to send request."
# ---------- end llm_message ----------
param_fetch = Python3Script(design_id="hello", fetch=Toggle(True))  # -> out, json_data, geometry_params
# ---------- param_fetch: Python ----------
"""
GH Python Component to Request and Retrieve Design Parameters from Flask

This component fetches completed design parameters from the Flask server
and prepares them for geometry generation.

Inputs:
    fetch: Boolean toggle to request parameters (True/False)
    design_id: Optional design ID to fetch specific parameters (string)

Outputs:
    json_data: Complete design parameters as JSON string for geometry generation
    materiality: Extracted materiality parameters (dictionary)
    geometry_params: Extracted geometry parameters (dictionary)
    info: Status information
"""
import json
import requests
import Rhino.Geometry as rg
import ghpythonlib.components as ghc

# Initialize outputs
json_data = "{}"
materiality = None
geometry_params = None
info = "Ready to fetch design parameters."

# Define the server URL
base_url = "http://localhost:5000"

# Function to fetch design parameters from the server
def fetch_design_parameters(design_id=None):
    endpoint = f"{base_url}/prepare_materiality_json"
    
    payload = {}
    if design_id:
        payload['design_id'] = design_id
    
    response = requests.post(endpoint, json=payload)
    
    if response.status_code == 200:
        return response.json(), "Parameters retrieved successfully."
    else:
        return None, f"Error retrieving parameters: {response.status_code}"

# Function to fetch geometry parameters
def fetch_geometry_parameters(design_id=None):
    endpoint = f"{base_url}/send_geometry_to_gh"
    
    payload = {}
    if design_id:
        payload['design_id'] = design_id
    
    response = requests.post(endpoint, json=payload)
    
    if response.status_code == 200:
        return response.json(), "Geometry parameters retrieved successfully."
    else:
        return None, f"Error retrieving geometry parameters: {response.status_code}"

# Main execution when fetch toggle is on
if fetch:
    try:
        # Fetch materiality parameters
        mat_params, mat_info = fetch_design_parameters(design_id)
        info = mat_info
        
        # Fetch geometry parameters
        geom_response, geom_info = fetch_geometry_parameters(design_id)
        info += "\n" + geom_info
        
        if mat_params and geom_response:
            geometry_params = geom_response.get('parameters', {})
            
            # Combine the parameters
            combined_params = {
                "materiality": mat_params,
                "geometry": geometry_params
            }
            
            # Update outputs
            json_data = json.dumps(combined_params, indent=2)
            materiality = mat_params
            
            info += "\nParameters ready for geometry generation."
        else:
            info += "\nFailed to retrieve complete parameter set."
            
    except Exception as e:
        info = f"Error fetching parameters: {str(e)}"
        import traceback
        print(traceback.format_exc())
else:
    info = "Fetch toggle is off. Switch on to request parameters."
# ---------- end param_fetch ----------
conversation_state = Python3Script(input_text="hello", run=Toggle(True), reset=Toggle(False))  # -> out, out_2, design_data
# ---------- conversation_state: Python ----------
"""
GH Python Component to Maintain Conversation State with LLM Server

This component extends the basic LLM message component by maintaining conversation state
and design data between interactions, providing a continuous conversation flow.

Inputs:
    input_text: Text input from the user (string)
    run: Boolean toggle to execute the request (True/False)
    reset: Boolean toggle to reset the conversation (True/False)

Outputs:
    out: Response from the LLM server (string)
    state: Current conversation state (string)
    design_data: Current design parameters (JSON string)
"""
import json
import requests
import Rhino.Geometry as rg
import ghpythonlib.components as ghc
import scriptcontext as sc

# Define the server URL
base_url = "http://localhost:5000"

# Initialize output
out = None
state = None
design_data = None

# Use Grasshopper's script context to persist data between runs
KEY_STATE = "LLM_CONVERSATION_STATE"
KEY_DESIGN_DATA = "LLM_DESIGN_DATA"

# Reset conversation if requested
if reset:
    if KEY_STATE in sc.sticky:
        del sc.sticky[KEY_STATE]
    if KEY_DESIGN_DATA in sc.sticky:
        del sc.sticky[KEY_DESIGN_DATA]
    out = "Conversation reset. Ready for new input."
    state = "initial"
    design_data = "{}"

# Get the current state and design data from sticky
current_state = sc.sticky.get(KEY_STATE, "initial")
current_design_data = sc.sticky.get(KEY_DESIGN_DATA, {})

# Execute when the run toggle is activated
if run:
    try:
        # Prepare the payload with the input text and current state/data
        payload = {
            'input': input_text,
            'state': current_state,
            'design_data': current_design_data
        }
        
        # Send the request to the Flask server
        response = requests.post(f"{base_url}/llm_message", json=payload)
        
        # Check if the request was successful
        if response.status_code == 200:
            data = response.json()
            out = data['response']
            
            # Update state and design data for future use
            new_state = data.get('state', current_state)
            new_design_data = data.get('design_data', current_design_data)
            
            # Store in sticky dictionary for persistence
            sc.sticky[KEY_STATE] = new_state
            sc.sticky[KEY_DESIGN_DATA] = new_design_data
            
            # Update outputs
            state = new_state
            design_data = json.dumps(new_design_data, indent=2)
            
            # Print debugging info
            print(f"State transition: {current_state} -> {new_state}")
            
            # Check if we've reached the complete state
            if new_state == "complete" and current_state != "complete":
                print("Design parameters complete! Ready for geometry generation.")
        else:
            out = f"❌ Error: Server returned status code {response.status_code}"
            
    except Exception as e:
        out = f"🔴 Error: {str(e)}"
        import traceback
        print(traceback.format_exc())
else:
    # Just output the current state info without making a request
    out = "Run toggle is off. Switch on to send request."
    state = current_state
    design_data = json.dumps(current_design_data, indent=2)
# ---------- end conversation_state ----------
geometry_gen = Python3Script(design_json="hello", run=Toggle(True))  # -> out, geometry, gfa, av, info; same code as llm_message
py3_2 = Python3Script(input_text=panel_2, run=toggle_2)  # -> out, out_2; disabled
# ---------- py3_2: Python ----------
import requests

url = 'http://localhost:5000/llm_message'
payload = {'input': input_text}

out = None
if run:
    try:
        response = requests.post(url, json=payload)
        if response.status_code == 200:
            data = response.json()
            out = data['response']
        else:
            out = "❌ Failed to connect."
    except Exception as e:
        out = f"⚠️ Error: {str(e)}"

a = out
# ---------- end py3_2 ----------
panel_3 = Panel(py3.out_2)  # disabled
panel_4 = Panel(llm_message.out_2)
panel_5 = Panel(py3_2.out_2)  # disabled
panel_6 = Panel(conversation_state.out_2)
panel_7 = Panel(param_fetch.json_data)
panel_8 = Panel(geometry_gen.gfa)
panel_9 = Panel(geometry_gen.av)
panel_10 = Panel(geometry_gen.info)
panel_11 = Panel(conversation_state.design_data)
panel_12 = Panel(param_fetch.geometry_params)
